# Grasshopper definition Capsule_Generation.gh (Grasshopper 0.9.76)

A = StartPoint()
Z = UnitZ(Factor=1)
radius = Radius()  # Radius Of Capsule
B = EndPoint()
subtraction = Subtraction(A=B, B=A)
pl = ConstructPlane(Origin=A, XAxis=subtraction, YAxis=Z)
ln = Line(StartPoint=A, EndPoint=B)
deplane = DeconstructPlane(Plane=pl)  # -> Origin, XAxis, YAxis, ZAxis
xprod = CrossProduct(VectorA=deplane.XAxis, VectorB=deplane.YAxis, Unitize=True)  # -> Vector, Length
multiplication = Multiplication(A=xprod.Vector, B=radius)
multiplication_2 = Multiplication(A=multiplication, B=-1)
unit = UnitVector(Vector=subtraction)
move = Move(Geometry=ln, Motion=multiplication)  # -> Geometry, Transform
multiplication_3 = Multiplication(A=unit, B=radius)
move_2 = Move(Geometry=ln, Motion=multiplication_2)  # -> Geometry, Transform
end = EndPoints(Curve=move.Geometry)  # -> Start, End
end_2 = EndPoints(Curve=move_2.Geometry)  # -> Start, End
multiplication_4 = Multiplication(A=multiplication_3, B=-1)
addition = Addition(A=A, B=multiplication_4)
addition_2 = Addition(A=B, B=multiplication_3)
arc = Arc3Pt(PointA=end.End, PointB=addition_2, PointC=end_2.End)  # -> Arc, Plane, Radius
arc_2 = Arc3Pt(PointA=end.Start, PointB=addition, PointC=end_2.Start)  # -> Arc, Plane, Radius
join = JoinCurves(Curves=[arc.Arc, arc_2.Arc, move.Geometry, move_2.Geometry], Preserve=False)
capsule_curve = CapsuleCurve(join)  # Capsule Curve
